# Dynamo graph Dynamo_ebpos_Cloude.dyn (Dynamo 3.3.0.6316)

python_script = Python()  # CPython3; unwired: IN[0]
# ---------- python_script.python (39 lines) ----------
# Mapeamento Nível (Revit) -> Peça a inserir no trecho ACIMA do nível
# Nomes de Family Type confirmados: "Barramento-Reto", "Barramento-Derivação-1 Plugue",
# "Barramento-Redução-1250A-1000A"

MAPA_NIVEIS = {
    "(-1)NO-SUBSOLO-ELT": {
        "peca": "INICIO",          # apenas ponto de partida, sai do QGBT
        "cm": None
    },
    "00NA-TÉRREO-ELT": {
        "peca": "Barramento-Derivação-1 Plugue",
        "cm": "CM_TERREO"
    },
    "01NA-2º PAVIMENTO - TIPO-ELT": {
        "peca": "Barramento-Reto",
        "cm": None
    },
    "02NA-3º PAVIMENTO - TIPO-ELT": {
        "peca": "Barramento-Derivação-1 Plugue",
        "cm": "CM_APTOS_TIPO"
    },
    "03NA-4º PAVIMENTO - TIPO-ELT": {
        "peca": "Barramento-Reto",
        "cm": None
    },
    "04NA-5º PAVIMENTO - DUPLEX INFERIOR-ELT": {
        "peca": "Barramento-Redução-1250A-1000A",   # + derivação no mesmo trecho
        "cm": "CM_DUPLEX",
        "peca_extra": "Barramento-Derivação-1 Plugue"
    },
    "05NA-6º PAVIMENTO - DUPLEX SUPERIOR-ELT": {
        "peca": "Barramento-Reto",
        "cm": None
    },
    "06NA-ÁTICO-ELT": {
        "peca": "Barramento-Derivação-1 Plugue",
        "cm": "CM_CONDOMINIO_ATICO"
    },
}
# ----------------------------------------
select_model_element = DSModelElementSelection()  # 1 picked in the model
geometry = Element.Geometry(element=select_model_element)
firstItem = List.FirstItem(list=geometry)
length = Curve.Length(curve=firstItem)
startPoint = Curve.StartPoint(curve=firstItem)
endPoint = Curve.EndPoint(curve=firstItem)
byTwoPoints = Vector.ByTwoPoints(start=startPoint, end=endPoint)
