# Dynamo graph MEGA Rotina_EDF_EBPOS.dyn (Dynamo 3.3.0.6316)

select_model_elements = DSModelElementsSelection()  # 1 picked in the model
family_types = FamilyTypes("Barramento-Reto:HBC-A-1000A")
family_types_2 = FamilyTypes("Barramento-Derivação-1 Plugue:HBC-A-1000A")
family_types_3 = FamilyTypes("Barramento-Redução-400A-2500A:HBC-A-1000A-0800A")
family_types_4 = FamilyTypes("Barramento-Reto:HBC-A-0800A")
family_types_5 = FamilyTypes("Barramento-Derivação-1 Plugue:HBC-A-0800A")
python_script = Python(IN[0]=select_model_elements, IN[1]=family_types, IN[2]=family_types_2, IN[3]=family_types_3, IN[4]=family_types_4, IN[5]=family_types_5)  # CPython3
# ---------- python_script.python (124 lines) ----------
import traceback

try:
    import clr
    clr.AddReference('RevitAPI')
    from Autodesk.Revit.DB import *
    from Autodesk.Revit.DB.Structure import StructuralType

    clr.AddReference('RevitServices')
    import RevitServices
    from RevitServices.Persistence import DocumentManager
    from RevitServices.Transactions import TransactionManager

    doc = DocumentManager.Instance.CurrentDBDocument

    # Função antiduplicidade
    def obter_elementos_unicos(dados):
        elementos, ids_vistos = [], set()
        def extrair(item):
            if isinstance(item, list):
                for i in item: extrair(i)
            else:
                elem = UnwrapElement(item)
                if elem and hasattr(elem, "Id"):
                    id_val = elem.Id.IntegerValue
                    if id_val not in ids_vistos:
                        ids_vistos.add(id_val)
                        elementos.append(elem)
        extrair(dados)
        return elementos

    elementos = obter_elementos_unicos(IN[0])
    
    # Mapeamento das 5 famílias
    fam_reto_alta = UnwrapElement(IN[1])
    fam_ed1_alta = UnwrapElement(IN[2])
    fam_redutor = UnwrapElement(IN[3])
    fam_reto_baixa = UnwrapElement(IN[4])
    fam_ed1_baixa = UnwrapElement(IN[5])
    
    NOME_PARAMETRO = "Comprimento"

    TransactionManager.Instance.EnsureInTransaction(doc)

    # Ativa todas as famílias para evitar erros
    for fam in [fam_reto_alta, fam_ed1_alta, fam_redutor, fam_reto_baixa, fam_ed1_baixa]:
        if fam and not fam.IsActive:
            fam.Activate()

    sucessos = 0
    relatorio = []

    for elem in elementos:
        if not hasattr(elem, "Location") or not hasattr(elem.Location, "Curve"):
            continue

        # 1. LEITURA INTELIGENTE DO NÍVEL
        try:
            nivel_id = elem.ReferenceLevel.Id if hasattr(elem, "ReferenceLevel") else elem.LevelId
            nivel = doc.GetElement(nivel_id)
            nome_nivel = nivel.Name.upper() if nivel else "DESCONHECIDO"
        except:
            nome_nivel = "DESCONHECIDO"

        # 2. SEPARADOR DE ALTA E BAIXA CORRENTE
        # A regra verifica se o andar está a jusante do redutor (Acima do 5º Pavimento)
        andares_baixa = ["6º", "7º", "8º", "9º", "ÁTICO", "COBERTURA", "BARRILETE", "RESERVATÓRIO"]
        is_baixa = any(andar in nome_nivel for andar in andares_baixa)

        # 3. O FILTRO DAS REGRAS (Cardápio Avançado)
        if "5º" in nome_nivel:
            fam_escolhida = fam_redutor
            tipo_nome = "REDUTOR (1000A -> 800A)"
            
        elif "TÉRREO" in nome_nivel or "3º" in nome_nivel or "7º" in nome_nivel or "ÁTICO" in nome_nivel:
            if is_baixa or "7º" in nome_nivel or "ÁTICO" in nome_nivel:
                fam_escolhida = fam_ed1_baixa
                tipo_nome = "DERIVAÇÃO (ED1) - 800A"
            else:
                fam_escolhida = fam_ed1_alta
                tipo_nome = "DERIVAÇÃO (ED1) - 1000A"
                
        else:
            if is_baixa:
                fam_escolhida = fam_reto_baixa
                tipo_nome = "RETO/FECHAMENTO - 800A"
            else:
                fam_escolhida = fam_reto_alta
                tipo_nome = "RETO/FECHAMENTO - 1000A"

        # 4. EXTRAÇÃO GEOMÉTRICA
        curva = elem.Location.Curve
        ponto_medio = curva.Evaluate(0.5, True)
        ponto_inicial = curva.GetEndPoint(0)
        ponto_final = curva.GetEndPoint(1)
        tamanho_exato = curva.Length
        
        # 5. INSERÇÃO E ROTAÇÃO
        novo_barramento = doc.Create.NewFamilyInstance(ponto_medio, fam_escolhida, StructuralType.NonStructural)
        doc.Regenerate()
        
        param_tamanho = novo_barramento.LookupParameter(NOME_PARAMETRO)
        if param_tamanho:
            param_tamanho.Set(tamanho_exato)
        
        direcao = (ponto_final - ponto_inicial).Normalize()
        angulo = XYZ.BasisX.AngleOnPlaneTo(direcao, XYZ.BasisZ)
        
        if angulo != 0:
            eixo_z_rot = Line.CreateBound(ponto_medio, ponto_medio + XYZ.BasisZ)
            ElementTransformUtils.RotateElement(doc, novo_barramento.Id, eixo_z_rot, angulo)
        
        # Apaga a eletrocalha nativa
        doc.Delete(elem.Id)
        
        sucessos += 1
        relatorio.append("Andar: " + nome_nivel + " -> Inserido: " + tipo_nome)

    TransactionManager.Instance.TransactionTaskDone()

    OUT = "SUCESSO! " + str(sucessos) + " peças modeladas e calculadas.\n\nRESUMO DA PRUMADA:\n" + "\n".join(relatorio)

except Exception as erro:
    OUT = "ERRO FATAL:\n" + traceback.format_exc()
# ----------------------------------------
